# Grasshopper definition Pangolin Pendant Leafs.gh (Grasshopper 1.0.7)
# plug-ins: LunchBox

# ---- group: RH_IN:Gap
gap = Slider(2, range=1..3)

# ---- group: RH_IN:Diameter
diameter = Slider(13, range=0..24)

# ---- group: RH_IN:Height
height = Slider(15, range=10..18)

# ----
center_of_bulbpt = Point(Point(0, 0, 0))

# ---- group: RH_IN:Flip
flip_direction = BooleanToggle(True)

# ---- group: RH_IN: TPDIA
top_diameter = Slider(0.331, range=0..1)

# ---- group: RH_IN:BTMDIA
bottom_diameter = Slider(0.784, range=0..1)

# ----
in_to_mm = Multiplication(A=gap, B=25.4)
in_to_mm_2 = Multiplication(A=height, B=25.4)
in_to_mm_3 = Multiplication(A=diameter, B=25.4)
num = Number(3)
divide_by_2 = Division(A=in_to_mm_2, B=2)
divide_by_2_2 = Division(A=in_to_mm_3, B=2)
circle = CircleCNR(Center=center_of_bulbpt, Normal=Vector(0, 0, 1), Radius=divide_by_2_2)
len = Length(Curve=circle)
division = Division(A=len, B=180)
expression = Expression(x=division, y=num, Expression="y*Round(x/y)")
division_2 = Division(A=360, B=expression)
addition = Addition(A=division_2, B=5)
rad = Radians(Degrees=addition)
rad_2 = Radians(Degrees=division_2)
Z = UnitZ(Factor=divide_by_2)
neg = Negative(Value=Z)
phi = GoldenRatio(Factor=1)
series = Series(Start=-1, Step=-1, Count=3)
series_2 = Series(Start=0, Step=rad_2, Count=expr("x", expression))
move = Move(Geometry=center_of_bulbpt, Motion=[Z, neg])  # -> Geometry, Transform
pow = Power(A=phi, B=series)
ins = InsertItems(List=reverse(pow), Item=[0, 1], Indices=[0, 3], Wrap=False)  # -> reverse(List)
item = ListItem(List=move.Geometry, Index=0, Wrap=True)
item_2 = ListItem(List=move.Geometry, Index=1, Wrap=True)
rev = ReverseList(List=ins)
filter = StreamFilter(Gate=flip_direction, Stream0=ins, Stream1=rev)
merge = Merge(Data1=item_2, Data2=center_of_bulbpt, Data3=item)
arc = Arc(Plane=merge, Radius=divide_by_2_2, Angle=rad)  # -> Arc, Length
divide = DivideCurve(Curve=arc.Arc, Count=4, Kinks=False)  # -> Points, Tangents, Parameters
vec2pt = Vector2Pt(PointA=divide.Points, PointB=graft(merge), Unitize=False)  # -> Vector, Length
line = LineSDL(Start=divide.Points, Direction=vec2pt.Vector, Length=in_to_mm)
eval = EvaluateCurve(Curve=line, Parameter=filter)  # -> Point, Tangent, Angle
viewer = ParamViewer(eval.Point)
item_3 = ListItem(List=viewer, Index=0, Wrap=True)  # -> Item, Item1, Item2
branch = TreeBranch(Tree=eval.Point, Path=item_3.Item, MaintainPaths=True)
branch_2 = TreeBranch(Tree=eval.Point, Path=item_3.Item2, MaintainPaths=True)
branch_3 = TreeBranch(Tree=eval.Point, Path=item_3.Item1, MaintainPaths=True)
scale = Scale(Geometry=branch, Center=item_2, Factor=bottom_diameter)  # -> Geometry, Transform
scale_2 = Scale(Geometry=branch_2, Center=item, Factor=top_diameter)  # -> Geometry, Transform
scale_3 = Scale(Geometry=branch_3, Center=center_of_bulbpt, Factor=Slider(1, range=0..1))  # -> Geometry, Transform
arc_2 = Arc3Pt(PointA=scale_2.Geometry, PointB=scale_3.Geometry, PointC=scale.Geometry)  # -> Arc, Plane, Radius
loft = Loft(Curves=arc_2.Arc, Options={Adjust=False, Closed=False, LoftEnds=0, LoftSimp=1, LoftType=0, Rebuild=10, Refit=0.01})
rotate = Rotate(Geometry=loft, Angle=series_2, Plane=PlaneXY(0, 0, 0))  # -> Geometry, Transform
trib = TrianglePanelsB(Surface=rotate.Geometry, UDivisions=1, VDivisions=5)
cull_i = CullIndex(List=trib, Indices=[0, 5], Wrap=True)  # -> simplify(List)

# ---- group: RH_IN:Coverage
number_slider = Slider(0.9, range=0.5..0.9)

# ----
area = Area(Geometry=cull_i)  # -> Area, Centroid
number_slider_2 = Slider(2, range=0..10)
scale_4 = Scale(Geometry=flatten(cull_i), Center=flatten(area.Centroid), Factor=number_slider)  # -> Geometry, Transform
explode = Explode(Curve=scale_4.Geometry, Recursive=True)  # -> Segments, Vertices
addition_2 = Addition(A=number_slider_2, B=1)
divide_2 = DivideCurve(Curve=explode.Segments, Count=number_slider_2, Kinks=False)  # -> simplify(Points), Tangents, Parameters
multiplication = Multiplication(A=addition_2, B=3)
partition = PartitionList(List=flatten(divide_2.Points), Size=multiplication)
cullpt = CullDuplicates(Points=partition, Tolerance=0.1, CullMode=3)  # -> Points, Indices, Valence
flatten = FlattenTree(Tree=area.Centroid, Path="{0}")

# ---- group: RH_IN:Bumpout
number_slider_3 = Slider(6, range=0..10)

# ----
vec2pt_2 = Vector2Pt(PointA=center_of_bulbpt, PointB=flatten, Unitize=False)  # -> Vector, Length
multiplication_2 = Multiplication(A=number_slider_3, B=0.01)
subtraction = Subtraction(A=400, B=vec2pt_2.Length)
multiplication_3 = Multiplication(A=subtraction, B=multiplication_2)
nurbs = NurbsCurve(Vertices=cullpt.Points, Degree=3, Periodic=True)  # -> simplify(Curve), Length, Domain
amp = Amplitude(Vector=vec2pt_2.Vector, Amplitude=multiplication_3)
move_2 = Move(Geometry=flatten, Motion=amp)  # -> simplify(graft(Geometry)), Transform
divide_3 = DivideCurve(Curve=nurbs.Curve, Count=20, Kinks=False)  # -> simplify(Points), Tangents, Parameters
merge_2 = Merge(Data1=divide_3.Points, Data2=move_2.Geometry)
del = DelaunayMesh(Points=merge_2, Plane=nurbs.Curve)
pipe = Pipe(Curve=nurbs.Curve, Radius=2.344867, Caps=0)  # disabled
mesh_uv = MeshSurface(Surface=pipe, UCount=30, VCount=5, Overhang=True, Equalize=False)  # -> simplify(Mesh); disabled
mjoin = MeshJoin(Meshes=del)
unim = UnifyMesh(Mesh=mjoin)  # -> Result, Count

# ---- group: RH_OUT:Mesh_Leafs
python = GhPythonScript(x=unim.Result)  # -> a; inputs x: Mesh
# ---------- python: Python ----------
import json
import Rhino.Geometry as rg

if x is None or not isinstance(x, rg.Mesh):
    a = json.dumps({"v": [], "f": []})
else:
    mesh = x
    mesh.Faces.ConvertQuadsToTriangles()
    
    verts = []
    for v in mesh.Vertices:
        verts.append([float(v.X), float(v.Y), float(v.Z)])
    
    face_list = []
    for f in mesh.Faces:
        face_list.append([int(f.A), int(f.B), int(f.C)])
    
    a = json.dumps({"v": verts, "f": face_list})
# ---------- end python ----------

# ----
panel = Panel(python)
