# Grasshopper definition Pangolin Pendant Rough Dim 2.gh (Grasshopper 1.0.7)
# plug-ins: LunchBox

gap = Slider(2, range=0..3)
center_of_bulbpt = Point(Point(0, 0, 0))
height = Slider(14, range=10..18)
diameter = Slider(12, range=0..24)
flip_direction = BooleanToggle(False)
Z = UnitZ(Factor=-46)
in_to_mm = Multiplication(A=gap, B=25.4)
in_to_mm_2 = Multiplication(A=height, B=25.4)
in_to_mm_3 = Multiplication(A=diameter, B=25.4)
center_of_bulb_point = Move(Geometry=center_of_bulbpt, Motion=Z)  # -> Geometry, Transform
num = Number(3)
divide_by_2 = Division(A=in_to_mm_2, B=2)
divide_by_2_2 = Division(A=in_to_mm_3, B=2)
circle = CircleCNR(Center=center_of_bulb_point.Geometry, Normal=Vector(0, 0, 1), Radius=divide_by_2_2)
len = Length(Curve=circle)
division = Division(A=len, B=180)
expression = Expression(x=division, y=num, Expression="y*Round(x/y)")
division_2 = Division(A=360, B=expression)
addition = Addition(A=division_2, B=5)
rad = Radians(Degrees=addition)
rad_2 = Radians(Degrees=division_2)
adjust_in = Slider(-1, range=-10..10)
Z_2 = UnitZ(Factor=divide_by_2)
round = Round(Number=division)  # -> Nearest, Floor, Ceiling
neg = Negative(Value=Z_2)
phi = GoldenRatio(Factor=1)
series = Series(Start=-1, Step=-1, Count=3)
series_2 = Series(Start=0, Step=rad_2, Count=expr("x", expression))
move = Move(Geometry=center_of_bulb_point.Geometry, Motion=[Z_2, neg])  # -> Geometry, Transform
conv_to_mm = Multiplication(A=adjust_in, B=25.4)
pow = Power(A=phi, B=series)
Z_3 = UnitZ(Factor=conv_to_mm)
ins = InsertItems(List=reverse(pow), Item=[0, 1], Indices=[0, 3], Wrap=False)  # -> reverse(List)
move_2 = Move(Geometry=move.Geometry, Motion=Z_3)  # -> Geometry, Transform
item = ListItem(List=move_2.Geometry, Index=1, Wrap=True)
item_2 = ListItem(List=move_2.Geometry, Index=0, Wrap=True)
rev = ReverseList(List=ins)
filter = StreamFilter(Gate=flip_direction, Stream0=ins, Stream1=rev)
merge = Merge(Data1=item, Data2=center_of_bulbpt, Data3=item_2)
arc = Arc(Plane=merge, Radius=divide_by_2_2, Angle=rad)  # -> Arc, Length
divide = DivideCurve(Curve=arc.Arc, Count=4, Kinks=False)  # -> Points, Tangents, Parameters
vec2pt = Vector2Pt(PointA=divide.Points, PointB=graft(merge), Unitize=False)  # -> Vector, Length
line = LineSDL(Start=divide.Points, Direction=vec2pt.Vector, Length=in_to_mm)
eval = EvaluateCurve(Curve=line, Parameter=filter)  # -> Point, Tangent, Angle
viewer = ParamViewer(eval.Point)
item_3 = ListItem(List=viewer, Index=0, Wrap=True)  # -> Item, Item1, Item2
branch = TreeBranch(Tree=eval.Point, Path=item_3.Item, MaintainPaths=True)
branch_2 = TreeBranch(Tree=eval.Point, Path=item_3.Item2, MaintainPaths=True)
branch_3 = TreeBranch(Tree=eval.Point, Path=item_3.Item1, MaintainPaths=True)
scale = Scale(Geometry=branch, Center=item, Factor=Slider(0.843, range=0..1))  # -> Geometry, Transform
scale_2 = Scale(Geometry=branch_2, Center=item_2, Factor=Slider(0.445, range=0..1))  # -> Geometry, Transform
scale_3 = Scale(Geometry=branch_3, Center=item_2, Factor=Slider(1, range=0..1))  # -> Geometry, Transform
arc_2 = Arc3Pt(PointA=scale_2.Geometry, PointB=scale_3.Geometry, PointC=scale.Geometry)  # -> Arc, Plane, Radius
intcrv = Interpolate(Vertices=[scale.Geometry, branch_3, scale_2.Geometry], Degree=3, Periodic=False, KnotStyle=1)  # -> Curve, Length, Domain
loft = Loft(Curves=arc_2.Arc, Options={Adjust=False, Closed=False, LoftEnds=0, LoftSimp=0, LoftType=0, Rebuild=10, Refit=0.01})
number_slider = Slider(5, range=0..20)
trib = TrianglePanelsB(Surface=loft, UDivisions=1, VDivisions=number_slider)  # -> simplify(graft(Panels))
num_2 = Number(0)
cull_i = CullIndex(List=flatten(trib), Indices=[num_2, number_slider], Wrap=True)  # -> graft(List)
edges = BrepEdges(Brep=cull_i)  # -> Naked, Interior, NonManifold
rotate = Rotate(Geometry=cull_i, Angle=series_2, Plane=PlaneXY(0, 0, 0))  # -> simplify(Geometry), Transform
len_2 = Length(Curve=edges.Naked)  # -> flatten(Length)
sort = SortList(Keys=len_2)  # -> Keys, ValuesA
rev_2 = ReverseList(List=sort.Keys)
item_4 = ListItem(List=rev_2, Index=0, Wrap=True)
smaller = SmallerThan(FirstNumber=item_4, SecondNumber=205)  # -> SmallerThan, OrEqualTo
mesh = MeshBrep(
    Brep=rotate.Geometry,
    Settings={GridMaxCount=0, GridMinCount=16, JaggedSeams=False, MaxEdgeLength=0, MinEdgeLength=0.0001, MinTolerance=0, Refine=True, RefineAngle=0, RelativeTolerance=0.65, SimplePlanes=True, Tolerance=0})
rh_out_geometry = Geometry(mesh)
